% Simulink data dictionary Rotor.sldd

RT_RotorRadius_P = Simulink.Parameter(7.82, DataType="single")
RT_BladeFlapInertia_P = Simulink.Parameter(2500, DataType="single")
RT_Cl_alpha_P = Simulink.Parameter(5.7, DataType="single")
RT_Chord_P = Simulink.Parameter(0.53, DataType="single")
RT_InertiaLead_P = Simulink.Parameter(3000, DataType="single")